# Grasshopper definition shortest_path.gh (Grasshopper 1.0.7)
# Copyright: © 2017-2022 Pierre Cuvilliers, Caitlin Mueller, Massachusetts Institute of Technology

brep = Brep(<brep referenced from the Rhino model>)
brep_2 = Brep([<brep referenced from the Rhino model> x10])
qrsettings = QuadRemeshSettings(TargetCount="100", AdaptiveSize=0, AdaptiveCount=False, HardEdges=False, SeamEdges=0, Symmetry=0, GuideCurves=0)
splitmul = SplitBrepMultiple(Brep=brep, Cutters=brep_2)
custom_mesh_settings = SettingsCustom(
    StitchSeams=True,
    SimplePlanes=False,
    Refine=True,
    MinCount=16,
    MaxCount=400,
    AspectRatio=20,
    MaxDistance=0,
    MaxAngle=20,
    MinEdge=0,
    MaxEdge=0)
item = ListItem(List=splitmul, Index=Slider(0, range=0..13), Wrap=True)
smooth = SettingsQuality()
mesh = MeshBrep(Brep=item, Settings=custom_mesh_settings)
faceb = FaceBoundaries(Mesh=mesh)
find_indices_of_neigbouring_faces = GhPythonScript(mesh_faces=faceb)  # -> out, ListLens, CollisionIndices; inputs mesh_faces: list of Polyline
# ---------- find_indices_of_neigbouring_faces: Python ----------
__author__ = "IlmoK"
__version__ = "2023.12.14"

import rhinoscriptsyntax as rs
import ghpythonlib.components as ghc


CollisionIndices = []
ListLens = []

for i in range(len(mesh_faces)):
    
    CollisionList = ghc.ReplaceItems(mesh_faces, 0, i, True)
    print CollisionList
    face = mesh_faces[i]
    isColliding = True
    count = 0
    
    while isColliding==True:
        
        CollisionData = ghc.CollisionOneXMany(face, CollisionList)
        isColliding = CollisionData[0]
        CollisionIndex  = CollisionData[1]
        
        if CollisionIndex!= -1:
            
            CollisionIndices.append(CollisionIndex)
            CollisionList = ghc.ReplaceItems( CollisionList, 0, CollisionIndex, True)
            count += 1

    ListLens.append(count)
# ---------- end find_indices_of_neigbouring_faces ----------
pythonremote = GHPythonRemote(location="C:\Users\IlmoK\.conda\envs\rhinoremote", run=Toggle(False), modules="numpy")  # -> out, linked_modules, rpy, import_statements
partition = PartitionList(List=find_indices_of_neigbouring_faces.CollisionIndices, Size=find_indices_of_neigbouring_faces.ListLens)
panel = Panel(pythonremote.out)
tstat = TreeStatistics(Tree=partition)  # -> Paths, Length, Count
python = GhPythonScript()  # -> out, a; inputs face_data: tree of Int32
# ---------- python: Python ----------
__author__ = "IlmoK"
__version__ = "2023.12.08"

import rhinoscriptsyntax as rs
import scriptcontext as sc

class Node:
    
    def __init__(self, point, adjacent):
        
        self.point = point
        self.adjacent = adjacent
        

def main ():
    
    np = sc.sticky["numpy"]
    list_A= [1, 5, 7, 9]
    list_B= [1, 3, 9, 9]
    print np.intersect1d(list_A, list_B)


if __name__=="__main__":
    main()
# ---------- end python ----------
item_2 = ListItem(List=tstat.Paths, Index="90", Wrap=True)
area = Area(Geometry=faceb)  # -> Area, Centroid
pt = Point(<point referenced from the Rhino model>)
pt_2 = Point(<point referenced from the Rhino model>)
branch = TreeBranch(Tree=partition, Path=item_2, MaintainPaths=True)
cp = ClosestPoint(Point=pt_2, Cloud=area.Centroid)  # -> ClosestPoint, CPIndex, Distance
cp_2 = ClosestPoint(Point=pt, Cloud=area.Centroid)  # -> ClosestPoint, CPIndex, Distance
tag = TextTag(Location=cp_2.ClosestPoint, Text="START")
tag_2 = TextTag(Location=cp.ClosestPoint, Text="GOAL")
dist = Distance(PointA=cp.ClosestPoint, PointB=area.Centroid)
bnd = Bounds(Numbers=dist)
remap = RemapNumbers(Value=dist, Source=bnd, Target=Domain(0, 1))  # -> Mapped, Clipped
gradient = Gradient(LowerLimit=0, UpperLimit=1, Parameter=remap.Mapped, stops=[0: RGB(0, 128, 0), 0.5: RGB(255, 255, 0), 1: RGB(255, 0, 0)])
python_2 = GhPythonScript(startPoint_i=cp_2.CPIndex, endPoint_i=cp.CPIndex, adjacentNodes_i=partition, nodes=area.Centroid, Heuristic_weight=dist)  # -> out, shortest_path; inputs startPoint_i: Int32, endPoint_i: Int32, adjacentNodes_i: tree of Int32, nodes: list of Point3d, Heuristic_weight: list
# ---------- python_2: Python ----------
__author__ = "IlmoK"
__version__ = "2023.12.14"

import rhinoscriptsyntax as rs
import ghpythonlib.components as ghc

shortest_path = []

class Node:
    
    def __init__(self, f_val, DistanceTravelled, previous_node, h, adjacentNodes, index, obj):
        

        self.f_val = f_val
        self.DistanceTravelled = DistanceTravelled
        self.previous_node = previous_node
        self.h = h
        self.adjacentNodes = adjacentNodes
        self.index = index
        self.obj = obj



def MapPath(node):
    
    shortest_path.append(node.obj)
    if node.previous_node == None:
        return
    MapPath(node.previous_node)


def main():
    
    Node_list = []

    for i in range(adjacentNodes_i.BranchCount):
        adjacentNodes = adjacentNodes_i.Branch(i)
        Node_list.append(Node( 0, 0, None, Heuristic_weight[i], adjacentNodes, i, nodes[i]))

    OpenNodes = []
    ClosedNodes = []

    currentNode = Node_list[startPoint_i]
    OpenNodes.append(currentNode)



    AdjNodes = currentNode.adjacentNodes
    

    while True:
    
    
        for adj_node_i in AdjNodes:
    
            adj_node = Node_list[ adj_node_i ]
    
            if adj_node not in ClosedNodes:
        
                h = adj_node.h
                node = adj_node.obj
                g = ghc.Distance( currentNode.obj, node ) + currentNode.DistanceTravelled
                f_new = g + h
                f_current = adj_node.f_val
        
                if f_current > f_new or f_current == 0:
                    adj_node.f_val = f_new
                    adj_node.previous_node = currentNode
                    adj_node.DistanceTravelled = g
            
                if adj_node not in OpenNodes:
                    OpenNodes.append(adj_node)

        ClosedNodes.append(currentNode)
        OpenNodes.remove(currentNode)

        currentNode = sorted(OpenNodes, key=lambda node: node.f_val, reverse=True)[len(OpenNodes)-1]

        if currentNode.index == endPoint_i:
            
            MapPath(currentNode)
            break
        AdjNodes = currentNode.adjacentNodes


if __name__=="__main__":
    main()
# ---------- end python_2 ----------
fpatch = FragmentPatch(Boundary=faceb)
pline = PolyLine(Vertices=python_2.shortest_path, Closed=False)
preview = CustomPreview(Geometry=fpatch, Material=gradient)
pipe = Pipe(Curve=pline, Radius=1, Caps=0)
len = Length(Curve=pline)
panel_2 = Panel(len)

# ==== cluster GHPythonRemote: Connects the Grasshopper Python component to an external Python instance.
python = PythonScript()  # -> default_working_dir
# ---------- python: Python ----------
from os import path
from Grasshopper.Folders import UserObjectFolders

cluster_comp = ghenv.Component.OnPingDocument().Owner
parent_doc_path = cluster_comp.OnPingDocument().FilePath

if parent_doc_path is not None:
    # Get path to parent GH document
    default_working_dir = path.abspath(path.dirname(parent_doc_path))
else:
    # Fallback to path to user objects default dir
    uo_folder = path.abspath(UserObjectFolders[0])
    if path.isdir(path.join(uo_folder, "gh-python-remote")):
        uo_folder = path.abspath(path.join(uo_folder, "gh-python-remote"))
    default_working_dir = uo_folder
# ---------- end python ----------
# GH to python remote example.
# ⓒ Pierre Cuvilliers, 2017-2022
# Released under the MIT license
# github.com/pilcru/ghpythonremote
# Runs and connects to an external python engine, and
# assigns imported modules to scriptcontext.sticky variables.
# 
# Arguments:
#       code (str): Path to the GH_to_python_sticky.py code file.
#       location (str): Path to a python executable, or to a folder
#             containing `python.exe`, or the name of a conda-created
#             virtual environment prefixed by `conda://` (`conda://env_name`).
#             If empty, finds python from your windows %PATH%.
#       run (boolean): Creates the connection, and imports new
#             modules, when turned to True. Kills the connection,
#             and deletes the references to the imports, when turned
#             to False.
#       modules (str list): List of module names to import in the
#             remote python. They will be added to the
#             scriptcontext.sticky dictionary, allowing them to be
#             reused from other python components in the same
#             Grasshopper document. Submodules (for example
#             `numpy.linalg` have to be added explicitly to this list
#             to be available later.
#       log_level (str from ['NOTSET', 'DEBUG', 'INFO', 'WARNING', 'ERROR', 'CRITICAL']):
#             Logging level to use for the local IronPython and the
#             remote python instance.
#       working_dir (str): Working directory for the remote python
#             instance.
# 
# Returns:
#       out (str): Console output with DEBUG information.
#       linked_modules (str list): list of imported module names.
#       rpy (rpyc connection object): The object representing the
#             remote Python interpreter.
location = ClusterInput()  # location (str): Path to a python executable, or to a folder containing `python.exe`, or the name of a conda-created virtual environment prefixed by `conda://` (`conda://env_name`). If empty, finds python from your windows %PATH%.
run = ClusterInput()  # run (boolean): Creates the connection, and imports new modules, when turned to True. Kills the connection,and deletes the references to the imports, when turned to False.
modules = ClusterInput()  # modules (str list): List of module names to import in the remote python. They will be added to the scriptcontext.sticky dictionary, allowing them to be reused from other python components in the same Grasshopper document. Submodules (for example `numpy.linalg` have to be added explicitly to this list to be available later.
list = ValueList({"CRITICAL", "ERROR", "WARNING", "INFO", "DEBUG", "NOTSET"}, selected="DEBUG")
panel = Panel(python)
ghpythonremote = GHPythonRemote(location=location, run=run, modules=modules, log_level=list, working_dir=panel)  # -> out, linked_modules, rpy; inputs run: Boolean, modules: list
# ---------- ghpythonremote: Python ----------
import inspect
import logging
from os import path
import sys
from time import sleep

import scriptcontext

import ghpythonremote
from ghpythonremote.connectors import GrasshopperToPythonRemote
from Grasshopper.Kernel.GH_RuntimeMessageLevel import Error, Warning

local_log_level = getattr(logging, log_level, logging.WARNING)
logger = logging.getLogger("ghpythonremote")
logger.setLevel(local_log_level)
ch = logging.StreamHandler()
ch.setLevel(local_log_level)
formatter = logging.Formatter("%(levelname)s: %(name)s:\n%(message)s")
ch.setFormatter(formatter)
logger.handlers = []
logger.addHandler(ch)
logger = logging.getLogger("ghpythonremote.GH_to_python")

ROOT = path.abspath(path.dirname(inspect.getfile(ghpythonremote)))
rpyc_server_py = path.join(ROOT, "pythonservice.py")

cluster_comp = ghenv.Component.OnPingDocument().Owner

# Set connection to CLOSED if this is the first run
# and initialize set of linked modules
try:
    remote_python_status
except NameError:
    remote_python_status = "CLOSED"
    lkd_modules = set()

# Wait for connection to connect or terminate
timer = 0
while remote_python_status == "CONNECTING" or remote_python_status == "CLOSING":
    sleep(1)
    timer += 1
    if timer == 10:
        try:
            gh2py_manager.__exit__(*sys.exc_info())
        except Exception:
            pass
        remote_python_status = "CLOSED"
        lkd_modules = set()
        message = (
            "Connection left in an inconsistent state and not returning. Reset "
            "everything."
        )
        if cluster_comp is not None:
            cluster_comp.AddRuntimeMessage(Warning, message)
        raise RuntimeError(message)

if run:
    if not remote_python_status == "OPEN":
        remote_python_status = "CONNECTING"
        gh2py_manager = GrasshopperToPythonRemote(
            rpyc_server_py,
            location=location,
            timeout=10,
            port=None,
            log_level=log_level,
            working_dir=working_dir,
        )
        gh2py = gh2py_manager.__enter__()
        remote_python_status = "OPEN"

    # Stuff that we can reach
    rpymod = gh2py.py_remote_modules  # A getter function for a named python module
    rpy = gh2py.connection  # Represents the remote instance root object
    scriptcontext.sticky["rpy"] = rpy
    # Add modules
    for mod in modules:
        try:
            scriptcontext.sticky[mod] = rpymod(mod)
            lkd_modules.add(mod)
        except ImportError:
            gh2py_manager.__exit__(*sys.exc_info())
            if cluster_comp is not None:
                cluster_comp.AddRuntimeMessage(
                    Error,
                    'Could not import module "{}" in remote Python.'.format(mod)
                )
            raise
        except EOFError:
            if cluster_comp is not None:
                cluster_comp.AddRuntimeMessage(
                    Error,
                    'Remote Python has been closed unexpectedly'
                )
            raise

elif not remote_python_status == "CLOSED":
    remote_python_status = "CLOSING"
    # Remove linked modules
    for mod in lkd_modules:
        del scriptcontext.sticky[mod]
    del scriptcontext.sticky["rpy"]
    gh2py_manager.__exit__(*sys.exc_info())
    lkd_modules = set()
    remote_python_status = "CLOSED"

# Change variable name because ghpython resets outputs to None before each run
linked_modules = lkd_modules

logger.info("GH to python connection is {}".format(remote_python_status))
# ---------- end ghpythonremote ----------
out = ClusterOutput(ghpythonremote.out)  # Console output.
linked_modules = ClusterOutput(ghpythonremote.linked_modules)  # Names of modules that were successfully added to the scriptcontext.sticky dictionary.
rpy = ClusterOutput(ghpythonremote.rpy)  # The object representing the remote python instance
python_2 = PythonScript(module_names=ghpythonremote.linked_modules)  # -> import_statements; inputs module_names: list
# ---------- python_2: Python ----------
import_statements = ["import scriptcontext as sc"]
for module_name in module_names:
    import_statements.append("{0} = sc.sticky['{0}']".format(module_name))

if len(module_names) == 0:
    import_statements = []
# ---------- end python_2 ----------
import_statements = ClusterOutput(python_2)  # Useful import statements to use the imported modules in your scripts.
