# Grasshopper definition waterdrop_route_Grasshopper_full.gh (Grasshopper 1.0.7)
# plug-ins: Kangaroo2 Components, MeshEdit Components

brep = Brep([<brep referenced from the Rhino model> x112])
brep_2 = Brep([<brep referenced from the Rhino model> x112])
brep_3 = Brep([<brep referenced from the Rhino model> x112])  # disabled
brep_4 = Brep(<brep referenced from the Rhino model>)

brep_5 = Brep([<brep referenced from the Rhino model> x224])
panel = Panel("0.8")

panel_2 = Panel("0.9")
brep_6 = Brep([<brep referenced from the Rhino model> x224])  # disabled

panel_3 = Panel("1 brick")
brep_7 = Brep(<brep referenced from the Rhino model>)

area = Area(Geometry=brep_4)  # -> Area, Centroid
scale = Scale(Geometry=brep_4, Center=area.Centroid, Factor=Slider(1, range=0..1.5))  # -> Geometry, Transform
brep_8 = Brep(<brep referenced from the Rhino model>)
mesh = MeshBrep(
    Brep=scale.Geometry,
    Settings={GridMaxCount=0, GridMinCount=16, JaggedSeams=False, MaxEdgeLength=0, MinEdgeLength=0.0001, MinTolerance=0, Refine=True, RefineAngle=0, RelativeTolerance=0.65, SimplePlanes=True, Tolerance=0})
brep_9 = Brep([<brep referenced from the Rhino model> x63])
mesh_2 = Mesh(<mesh referenced from the Rhino model>)
preview = CustomPreview(
    Geometry=mesh,
    Material={diffuse=RGB(221, 160, 221), emission=RGB(66, 48, 66), shine=0.5, specular=RGB(255, 255, 255), transparency=0})
mesh_3 = MeshBrep(
    Brep=brep_9,
    Settings={GridMaxCount=0, GridMinCount=16, JaggedSeams=False, MaxEdgeLength=0, MinEdgeLength=0.0001, MinTolerance=0, Refine=True, RefineAngle=0, RelativeTolerance=0.65, SimplePlanes=True, Tolerance=0})
mjoin = MeshJoin(Meshes=mesh_2)
mjoin_2 = MeshJoin(Meshes=mesh_3)
preview_2 = CustomPreview(
    Geometry=mjoin_2,
    Material={diffuse=RGB(250, 250, 250), emission=RGB(0, 0, 0), shine=0, specular=RGB(255, 255, 255), transparency=0})
facen = FaceNormals(Mesh=mjoin_2)  # -> Centers, Normals
vdis = VectorDisplay(Anchor=facen.Centers, Vector=facen.Normals)
brep_10 = Brep(<brep referenced from the Rhino model>)
mesh_4 = MeshBrep(
    Brep=brep_10,
    Settings={GridMaxCount=0, GridMinCount=16, JaggedSeams=False, MaxEdgeLength=0, MinEdgeLength=0.0001, MinTolerance=0, Refine=True, RefineAngle=0, RelativeTolerance=0.65, SimplePlanes=True, Tolerance=0})
brep_11 = Brep(<brep referenced from the Rhino model>)
pt = Point([<point referenced from the Rhino model> x12])
facen_2 = FaceNormals(Mesh=mesh_4)  # -> Centers, Normals
python = GhPythonScript(
    start_points=pt,
    object=mjoin_2,
    floor=brep_11,
    steps=Slider(10000, range=1..10000),
    step_size=Slider(0.378, range=0..2),
    sliding_angle="27",
    drop_angle="153",
    normals=facen.Normals)  # -> out, points, x_ax, routes, point; inputs start_points: list of Point3d, object: Mesh, floor: Surface, steps: Int32, normals: list of Vector3d
# ---------- python: Python ----------
__author__ = "IlmoK"
__version__ = "2022.07.06"

import rhinoscriptsyntax as rs
import ghpythonlib.components as ghc



x_ax = []
point = []
routes = []
neg_Z = ghc.VectorXYZ(0, 0, -1)[0]




def main():
    for p_start in start_points:
        points = []
        points.append(p_start)
        p = ghc.ProjectPoint(p_start, neg_Z, object)[0]
        points.append(p)

        for x in range(0, steps):
            try:
                angle, normal, X_axis = GetAngle(p, object, neg_Z)
                print angle
                if angle <= sliding_angle:
                    points.append(p)
                    break
                elif angle > sliding_angle and angle <= drop_angle:
                    p = ProjectAlongNormal(X_axis, p, normal, object, points)
                    if p.Z == points[-1].Z:
                        p = ProjectVertically(p, neg_Z, object)
                    points.append(p)
                elif angle > drop_angle:
                    p_start = p
                    p = ProjectVertically(p, neg_Z, object)
                    if p==None:
                        p = ProjectVertically(p_start, neg_Z, floor)
                        points.append(p)
                        break
                    points.append(p)
            except Exception as e:
                print e
        routes.append( ghc.PolyLine(points, False))



def ProjectAlongNormal(X_axis, p, normal, object, points):

    p = ghc.Move(p, (X_axis*step_size+normal*(-0.05)))[0]
    p = ghc.MeshClosestPoint(p, object)[0]
#    x = 0.1
#    #print p
#    while ghc.Distance(p,points[-1])<step_size:
#        p = ghc.Move(p, (X_axis*step_size+normal*(-0.05-x)+neg_Z*(x)))[0]
#        p = ghc.BrepClosestPoint(p, object)[0]
#        x += 0.1

    return p


def GetAngle(p, object, neg_Z):
    normal = normals[ghc.MeshClosestPoint(p, object)[1]]
    plane = ghc.PlaneNormal(p, normal)
    plane_aligned = ghc.AlignPlane(plane, neg_Z)[0]
    X_axis = ghc.DeconstructPlane(plane_aligned)[1]
    
    XY_plane = ghc.PlaneNormal(p, ghc.UnitZ(1))
    XY_plane_aligned = ghc.AlignPlane(XY_plane, X_axis)[0]
    XY_X_axis = ghc.DeconstructPlane(XY_plane_aligned)[1]
    angle = ghc.Degrees(ghc.Angle(X_axis, XY_X_axis)[0])
    angle = AngleCorrection( angle, normal)
    print angle
    return angle, normal, X_axis


def ProjectVertically(p, neg_Z, object_dc):
    p = ghc.Move(p, neg_Z*0.08)[0]
    p = ghc.ProjectPoint(p, neg_Z, object_dc)[0]
    return p


def AngleCorrection(angle, normal):

    Z_value = ghc.DeconstructVector(normal)[2]
    if Z_value < 0:
        return 180 - angle
    else:
        return angle


if __name__ == "__main__":
    main()
# ---------- end python ----------
python_2 = GhPythonScript(object=mesh_4, point=flatten(facen_2.Centers), normals=facen_2.Normals)  # -> out, text; inputs object: Mesh, point: list of Point3d, normals: list of Vector3d
# ---------- python_2: Python ----------
__author__ = "IlmoK"
__version__ = "2022.07.06"

import rhinoscriptsyntax as rs
import ghpythonlib.components as ghc



x_ax = []
routes = []
neg_Z = ghc.VectorXYZ(0, 0, -1)[0]
text = []


def main():
    
    global text
    neg_Z = ghc.VectorXYZ(0, 0, -1)[0]
    for p in point:
        print GetAngle(p, object, neg_Z)
        text.append(GetAngle(p, object, neg_Z))




def GetAngle(p, object, neg_Z):
    normal = normals[ghc.MeshClosestPoint(p, object)[1]]
    plane = ghc.PlaneNormal(p, normal)
    plane_aligned = ghc.AlignPlane(plane, neg_Z)[0]
    X_axis = ghc.DeconstructPlane(plane_aligned)[1]
    XY_plane = ghc.PlaneNormal(p, ghc.UnitZ(1))
    XY_plane_aligned = ghc.AlignPlane(XY_plane, X_axis)[0]
    XY_X_axis = ghc.DeconstructPlane(XY_plane_aligned)[1]
    angle = ghc.Degrees(ghc.Angle(X_axis, XY_X_axis)[0])
    angle = AngleCorrection( angle, normal)
    return angle




def AngleCorrection(angle, normal):

    Z_value = ghc.DeconstructVector(normal)[2]
    if Z_value < 0:
        return 180 - angle
    else:
        return angle


if __name__ == "__main__":
    main()
# ---------- end python_2 ----------
explode = MeshExplode(Mesh=mesh_4, Interpolate=False)
divide = DivideCurve(Curve=python.routes, Count="100", Kinks=False)  # -> Points, Tangents, Parameters
demesh = DeconstructMesh(Mesh=explode)  # -> Vertices, Faces, Colours, Normals
area_2 = Area(Geometry=explode)  # -> Area, Centroid
item = ListItem(List=demesh.Vertices, Index=0, Wrap=True)
xy = XYPlane(Origin=divide.Points)
number_slider = Slider(0.1, range=0..1)
ln = Line(StartPoint=flatten(item), EndPoint=area_2.Centroid)
crv = Curve([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])
msphere = MeshSphere(Base=xy, Radius=Slider(1.208, range=0..2), UCount=10, VCount=20)
mp = MultiPipe(Curves=crv, NodeSize=Slider(1, range=0..1), EndOffset=1, StrutSize=1, Segment=0, KinkAngle=0.6, CubeFit=0, Caps=0)
